# Grasshopper definition image-import-to-rhino.gh (Grasshopper 1.0.8)

panel = Panel("C:/Users/Varun SA/Documents/rhino-sketch-interface/sketches")
python_3_script = Python3Script(folder=panel, refresh=Toggle(True))  # -> a
# ---------- python_3_script: Python ----------
import os

# Only run if the button is clicked
if refresh:

    # Check if folder exists
    if not os.path.exists(folder):
        a = "Folder does not exist"

    else:
        # List all numbered PNG files
        pngs = [
            f for f in os.listdir(folder)
            if f.endswith(".png") and f.split(".")[0].isdigit()
        ]

        if not pngs:
            a = "No PNG files found"
        else:
            # Pick the one with the highest number
            highest_file = max(pngs, key=lambda x: int(x.split(".")[0]))

            # Create full path
            image_path = os.path.join(folder, highest_file)

            # Output the latest path
            a = image_path
else:
    # If refresh is not clicked, keep output empty
    a = None
# ---------- end python_3_script ----------
import_image = ImportImage(File=python_3_script)
scale = Scale(Geometry=import_image, Center=Point(0, 0, 0), Factor=Slider(2, range=0.1..100))  # -> Geometry, Transform
